# Grasshopper definition pipeline.gh (Grasshopper 1.0.7)
# plug-ins: LunchBox, Human UI, LadybugGrasshopper

plus = Panel("10")
minus = Panel("10")
X = Panel("8.5")
Y = Panel("-10.5")
Z = Panel("50")
effect_region = Slider(0.03, range=0..0.2)
position = Slider(0.32, range=0..1)
severity = Slider(0.73, range=0..1)
addition = Addition(A=Z, B=plus)
addition_2 = Addition(A=Y, B=plus)
subtraction = Subtraction(A=Y, B=minus)
boolean_toggle = BooleanToggle(True)
gene_pool = GenePool(Decimals=2, Maximum=1.2, Minimum=0, Value=[0.62, 0.46, 0.45, 0.21])
gene_pool_2 = GenePool(Decimals=2, Maximum=1.2, Minimum=0, Value=[0.75, 0.61, 0.51, 0.21])
gene_pool_3 = GenePool(Decimals=2, Maximum=1, Minimum=0, Value=[0, 0.3, 0.62, 1])
positionerprimaryangle = Slider(28.6, range=-100..60)
gene_pool_4 = GenePool(Decimals=2, Maximum=1.2, Minimum=0, Value=[0.78, 0.69, 0.51, 0.21])
adjustable_isocenter = ConstructPoint(XCoordinate=X, YCoordinate=Y, ZCoordinate=Z)
y_direction = ConstructPoint(XCoordinate=X, YCoordinate=addition_2, ZCoordinate=Z)
y_direction_2 = ConstructPoint(XCoordinate=X, YCoordinate=subtraction, ZCoordinate=Z)
z_direction = ConstructPoint(XCoordinate=X, YCoordinate=Y, ZCoordinate=addition)
stnosis_generator = GhPythonScript(stenosis_point=position, effect_region=effect_region, percentage=severity)  # -> positions_param, positions_radii
# ---------- stnosis_generator: Python ----------
__author__ = "gaozj"
__version__ = "2021.09.07"

import rhinoscriptsyntax as rs

baseline_radii = [1.8, 1.6, 1.5, 1.45, 1.4, 1.35, 1.3, 1.25, 1.1, 0.9, 0.7, 0.5, 0.3]

def get_radii(target_point, positions, baseline_radii):
    for index, pos in enumerate(positions):
        if pos <= target_point < positions[index+1]:
            relative_indice = (index, index+1)
            ref_position = positions[index:index+2]
            ref_radii = baseline_radii[index:index+2]
    target_radii = ref_radii[0] - (target_point - ref_position[0])*(ref_radii[0] - ref_radii[1])/(ref_position[1] - ref_position[0])
    return target_radii

def generate_stenosis(baseline_radii, stenosis_point, effect_region, percentage):
    ref_point = len(baseline_radii)
    positions_prep = list(range(0,ref_point,1))
    positions = [round(i/(ref_point-1),2) for i in positions_prep]
    
    stenosis_region_start = stenosis_point - effect_region
    stenosis_region_end = stenosis_point + effect_region
    
    # Obtain the indice of the reference points that fall into the stenosis range
    indice_within_region = []
    # Obtain the indice of the reference points that closest to the stenosis point
    for index, pos in enumerate(positions):
        if stenosis_region_start <= pos <= stenosis_region_end:
            indice_within_region.append(index)
        if pos <= stenosis_point < positions[index+1]:
            stenosis_relative_indices = (index, index+1)
            
    # print(indice_within_region)
    start_radii = round(get_radii(stenosis_region_start, positions, baseline_radii),2)
    stenosis_radii = round((1-percentage)*get_radii(stenosis_point, positions, baseline_radii),2)
    end_radii = round(get_radii(stenosis_region_end, positions, baseline_radii),2)

    if len(indice_within_region) == 0:
        # None of the original reference points fall into the stenosis region, 
        # to create a stenosis, add three additional reference points to the 
        # point list at the position of the stenosis_relative_indices
        ref_index = stenosis_relative_indices[1]
        positions[ref_index:ref_index] = [stenosis_region_start, stenosis_point, stenosis_region_end]   
        baseline_radii[ref_index:ref_index] = [start_radii, stenosis_radii, end_radii]
    else:
        # One or more of the original reference points fall into the stenosis region, 
        # replace them with the stenosis region reference points
        positions[min(indice_within_region):max(indice_within_region)+1] = [stenosis_region_start, stenosis_point, stenosis_region_end]
        baseline_radii[min(indice_within_region):max(indice_within_region)+1] = [start_radii, stenosis_radii, end_radii]
    positions_out = [round(position,2) for position in positions]
    return positions_out, baseline_radii

positions_param, positions_radii = generate_stenosis(baseline_radii, stenosis_point, effect_region, percentage)
# ---------- end stnosis_generator ----------
main_branch = Curve(reparameterize(<curve referenced from the Rhino model>))
curve = Curve(reparameterize(<curve referenced from the Rhino model>))
curve_2 = Curve(reparameterize(<curve referenced from the Rhino model>))
curve_3 = Curve(reparameterize(<curve referenced from the Rhino model>))
curve_4 = Curve(reparameterize(<curve referenced from the Rhino model>))
curve_5 = Curve(reparameterize(<curve referenced from the Rhino model>))
positionersecondaryangle = Slider(2.3, range=-40..40)
vector_z = Vector2Pt(PointA=adjustable_isocenter, PointB=z_direction, Unitize=False)  # -> Vector, Length
vector_y = Vector2Pt(PointA=adjustable_isocenter, PointB=y_direction, Unitize=False)  # -> Vector, Length
vector_y_2 = Vector2Pt(PointA=adjustable_isocenter, PointB=y_direction_2, Unitize=False)  # -> Vector, Length
radians = Radians(Degrees=positionerprimaryangle)
sub_branch_blue = PipeVariable(Curve=curve, Parameters=gene_pool_3, Radii=gene_pool, Caps=boolean_toggle)
sub_branch_green = PipeVariable(Curve=curve_2, Parameters=gene_pool_3, Radii=gene_pool_4, Caps=boolean_toggle)
sub_branch_purple = PipeVariable(Curve=curve_3, Parameters=gene_pool_3, Radii=gene_pool_2, Caps=boolean_toggle)
sub_branch_yellow = PipeVariable(Curve=curve_4, Parameters=gene_pool_3, Radii=gene_pool_2, Caps=boolean_toggle)
sub_branch_light_blue = PipeVariable(Curve=curve_5, Parameters=gene_pool_3, Radii=gene_pool_4, Caps=boolean_toggle)
major_vessel = PipeVariable(
    Curve=main_branch,
    Parameters=stnosis_generator.positions_param,
    Radii=stnosis_generator.positions_radii,
    Caps=boolean_toggle)
xy_plane = PlaneNormal(Origin=adjustable_isocenter, ZAxis=vector_z.Vector)  # disabled
xz_plane = PlaneNormal(Origin=adjustable_isocenter, ZAxis=vector_y.Vector)  # disabled
point = Point(adjustable_isocenter)
radians_2 = Radians(Degrees=positionersecondaryangle)
width = Panel("100")
primary_rotate = Rotate(Vector=vector_y_2.Vector, AlongAxis=vector_z.Vector, Angle=radians)
split_brep = SplitBrep(Brep=sub_branch_blue, Cutter=major_vessel)
split_brep_2 = SplitBrep(Brep=sub_branch_light_blue, Cutter=major_vessel)
split_brep_3 = SplitBrep(Brep=sub_branch_green, Cutter=major_vessel)
split_brep_4 = SplitBrep(Brep=sub_branch_purple, Cutter=major_vessel)
split_brep_5 = SplitBrep(Brep=sub_branch_yellow, Cutter=major_vessel)
width_2 = Panel("10")
dispatch = Dispatch(List=split_brep, DispatchPattern=[True, False])  # -> ListA, ListB
dispatch_2 = Dispatch(List=split_brep_2, DispatchPattern=[True, False])  # -> ListA, ListB
dispatch_3 = Dispatch(List=split_brep_5, DispatchPattern=[True, False])  # -> ListA, ListB
dispatch_4 = Dispatch(List=split_brep_4, DispatchPattern=[True, False])  # -> ListA, ListB
dispatch_5 = Dispatch(List=split_brep_3, DispatchPattern=[True, False])  # -> ListA, ListB
vector_display_ex = VectorDisplayEx(Point=adjustable_isocenter, Vector=primary_rotate, Colour=ColourSwatch(SwatchColor=RGB(4, 0, 250)), Width=width_2)  # disabled
point_2 = Point(adjustable_isocenter)
brep = Brep(dispatch_3.ListA)
brep_2 = Brep(dispatch_2.ListA)
brep_3 = Brep(dispatch_5.ListA)
brep_4 = Brep(dispatch_4.ListA)
brep_5 = Brep(dispatch.ListA)
get_endpoint = Addition(Origin=point_2, Vector=primary_rotate)
mesh_brep = MeshBrep(
    Brep=major_vessel,
    Settings={GridMaxCount=0, GridMinCount=16, JaggedSeams=False, MaxEdgeLength=0, MinEdgeLength=0.0001, MinTolerance=0, Refine=True, RefineAngle=0, RelativeTolerance=0.65, SimplePlanes=True, Tolerance=0})
mesh_brep_2 = MeshBrep(
    Brep=brep_4,
    Settings={GridMaxCount=0, GridMinCount=16, JaggedSeams=False, MaxEdgeLength=0, MinEdgeLength=0.0001, MinTolerance=0, Refine=True, RefineAngle=0, RelativeTolerance=0.65, SimplePlanes=True, Tolerance=0})
mesh_brep_3 = MeshBrep(
    Brep=brep_3,
    Settings={GridMaxCount=0, GridMinCount=16, JaggedSeams=False, MaxEdgeLength=0, MinEdgeLength=0.0001, MinTolerance=0, Refine=True, RefineAngle=0, RelativeTolerance=0.65, SimplePlanes=True, Tolerance=0})
mesh_brep_4 = MeshBrep(
    Brep=brep_2,
    Settings={GridMaxCount=0, GridMinCount=16, JaggedSeams=False, MaxEdgeLength=0, MinEdgeLength=0.0001, MinTolerance=0, Refine=True, RefineAngle=0, RelativeTolerance=0.65, SimplePlanes=True, Tolerance=0})
mesh_brep_5 = MeshBrep(
    Brep=brep,
    Settings={GridMaxCount=0, GridMinCount=16, JaggedSeams=False, MaxEdgeLength=0, MinEdgeLength=0.0001, MinTolerance=0, Refine=True, RefineAngle=0, RelativeTolerance=0.65, SimplePlanes=True, Tolerance=0})
mesh_brep_6 = MeshBrep(
    Brep=brep_5,
    Settings={GridMaxCount=0, GridMinCount=16, JaggedSeams=False, MaxEdgeLength=0, MinEdgeLength=0.0001, MinTolerance=0, Refine=True, RefineAngle=0, RelativeTolerance=0.65, SimplePlanes=True, Tolerance=0})
colour_swatch = ColourSwatch(SwatchColor=RGB(250, 0, 0))
distancesourcetodetector = Slider(942.1, range=600..1200)
distancesourcetodetector_2 = Slider(1003, range=800..1400)
point_3 = Point(get_endpoint)
ypz_plane = Plane3Pt(PointA=adjustable_isocenter, PointB=point_3, PointC=z_direction)
deconstruct_plane = DeconstructPlane(Plane=ypz_plane)  # -> Origin, XAxis, YAxis, ZAxis
secondary_rotate = Rotate(Vector=primary_rotate, Axis=deconstruct_plane.ZAxis, Angle=radians_2)
plane_normal = PlaneNormal(Origin=point, ZAxis=secondary_rotate)
vector_display = VectorDisplay(Anchor=adjustable_isocenter, Vector=deconstruct_plane.ZAxis)
get_endpoint_2 = Addition(Origin=point_2, Vector=secondary_rotate)
custom_preview = CustomPreview(Geometry=mesh_brep_4, Material=ColourSwatch(SwatchColor=RGB(31, 214, 242)))
custom_preview_2 = CustomPreview(Geometry=mesh_brep_5, Material=ColourSwatch(SwatchColor=RGB(239, 242, 31)))
custom_preview_3 = CustomPreview(Geometry=mesh_brep_2, Material=ColourSwatch(SwatchColor=RGB(179, 31, 242)))
custom_preview_4 = CustomPreview(Geometry=mesh_brep_3, Material=ColourSwatch(SwatchColor=RGB(42, 250, 0)))
custom_preview_5 = CustomPreview(Geometry=mesh_brep_6, Material=ColourSwatch(SwatchColor=RGB(0, 46, 250)))
custom_preview_6 = CustomPreview(Geometry=mesh_brep, Material=ColourSwatch(SwatchColor=RGB(242, 31, 105)))
vector_display_ex_2 = VectorDisplayEx(Point=adjustable_isocenter, Vector=secondary_rotate, Colour=colour_swatch, Width=width_2)  # disabled
point_4 = Point(get_endpoint_2)
vector_light = Vector2Pt(PointA=point_4, PointB=point, Unitize=False)  # -> Vector, Length
subtraction_2 = Subtraction(A=distancesourcetodetector, B=distancesourcetodetector_2)
receive_screen = PlaneOffset(BasePlane=plane_normal, Offset=subtraction_2)
mesh_shadow = MeshShadow(Mesh=mesh_brep_6, Light=vector_light.Vector, Plane=receive_screen)
mesh_shadow_2 = MeshShadow(Mesh=mesh_brep_4, Light=vector_light.Vector, Plane=receive_screen)
mesh_shadow_3 = MeshShadow(Mesh=mesh_brep_3, Light=vector_light.Vector, Plane=receive_screen)
mesh_shadow_4 = MeshShadow(Mesh=mesh_brep_2, Light=vector_light.Vector, Plane=receive_screen)
mesh_shadow_5 = MeshShadow(Mesh=mesh_brep, Light=vector_light.Vector, Plane=receive_screen)
mesh_shadow_6 = MeshShadow(Mesh=mesh_brep_5, Light=vector_light.Vector, Plane=receive_screen)
vector_display_ex_3 = VectorDisplayEx(Point=adjustable_isocenter, Vector=vector_light.Vector, Colour=colour_swatch, Width=width_2)
colour_swatch_2 = ColourSwatch(SwatchColor=RGB(0, 0, 0))
divide_curve = DivideCurve(Curve=main_branch, Count=width, Kinks=False)  # -> Points, Tangents, Parameters
distancesourcetodetector_3 = Slider(152, range=0..200)
curve_6 = Curve(mesh_shadow_5)
deconstruct_plane_2 = DeconstructPlane(Plane=receive_screen)  # -> Origin, XAxis, YAxis, ZAxis
contour = Contour(
    Shape=mesh_brep,
    Point=deconstruct_plane_2.Origin,
    Direction=deconstruct_plane_2.ZAxis,
    Distance=Slider(0.15, range=0..8))
colour_swatch_3 = ColourSwatch(SwatchColor=RGBA(0, 0, 0, 11))
plane_surface = PlaneSurface(Plane=receive_screen, XSize=distancesourcetodetector_3, YSize=distancesourcetodetector_3)
polygon_center = PolygonCenter(Polyline=plane_surface)  # -> CenterV, CenterE, CenterA
line = Line(StartPoint=deconstruct_plane_2.Origin, EndPoint=polygon_center.CenterV)
gradient_hatch = GradientHatch(Boundaries=curve_6, Axis=line, Colour1=colour_swatch_2, Colour2=colour_swatch_2)  # disabled
vector_2pt = Vector2Pt(PointA=polygon_center.CenterV, PointB=deconstruct_plane_2.Origin, Unitize=False)  # -> Vector, Length
move = Move(Geometry=plane_surface, Motion=vector_2pt.Vector)  # -> Geometry, Transform
pull_curve = PullCurve(Curve=contour, Surface=move.Geometry)
gradient_hatch_2 = GradientHatch(Boundaries=pull_curve, Axis=line, Colour1=colour_swatch_3, Colour2=colour_swatch_3)
colour_swatch_4 = ColourSwatch(SwatchColor=RGB(255, 255, 255))
gradient_hatch_3 = GradientHatch(Boundaries=move.Geometry, Axis=line, Colour1=colour_swatch_4, Colour2=colour_swatch_4)
pull_point = PullPoint(Point=divide_curve.Points, Geometry=move.Geometry, ClosestOnly=True)  # -> ClosestPoint, Distance
set_3d_view = Set3DView()
view = HBView()  # -> view; plug-in component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
create_csv = CreateCSV(DataGridHeaders="x,y,z", ValueTree=pull_point.ClosestPoint, Delimiter=",")
captureview = LBCaptureView(viewport=view)  # -> Output; plug-in component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
lb_imageviewer = LBImageViewer(_scale_=1, DisableClickable=True, SaveImgWithCoords=False, scale=1)  # -> ImagePath, Values, GIF
